# Grasshopper definition 000.basic.ghx (Grasshopper 0.9.76)

matrix = CSharpScript()  # -> out, A
# ---------- matrix: C# ----------
    A = new Rhino.Geometry.Matrix(3, 3);
# ---------- end matrix ----------
point = CSharpScript()  # -> out, A
# ---------- point: C# ----------
    A = new Rhino.Geometry.Point3d(1, 3, 4);
# ---------- end point ----------
vec = CSharpScript()  # -> out, A
# ---------- vec: C# ----------
    A = new Rhino.Geometry.Vector3d(0, 4, 2);
# ---------- end vec ----------
plane = CSharpScript()  # -> out, A
# ---------- plane: C# ----------
    A = new Rhino.Geometry.Plane(Point3d.Origin, Vector3d.XAxis, Vector3d.ZAxis);
# ---------- end plane ----------
cone = CSharpScript()  # -> out, A
# ---------- cone: C# ----------
    A = new Rhino.Geometry.Cone(Plane.WorldXY, 10, 3);
# ---------- end cone ----------
circle = CSharpScript()  # -> out, A
# ---------- circle: C# ----------
    A = new Rhino.Geometry.Circle(4);
# ---------- end circle ----------
bezier = CSharpScript()  # -> out, A
# ---------- bezier: C# ----------
    A = new Rhino.Geometry.BezierCurve(new Point3d[]{new Point3d(0, 0, 0),new Point3d(5, 3, 0),new Point3d(8, -1, 0)}).ToNurbsCurve();
# ---------- end bezier ----------
cyl = CSharpScript()  # -> out, A
# ---------- cyl: C# ----------
    A = new Rhino.Geometry.Cylinder(new Circle(4), 10);
# ---------- end cyl ----------
line = CSharpScript()  # -> out, A
# ---------- line: C# ----------
    A = new Rhino.Geometry.Line(Point3d.Origin, new Point3d(1, 4, 2));
# ---------- end line ----------
torus = CSharpScript()  # -> out, A
# ---------- torus: C# ----------
    A = new Rhino.Geometry.Torus(Plane.WorldXY, 10, 3);
# ---------- end torus ----------
arc = CSharpScript()  # -> out, A
# ---------- arc: C# ----------
    A = new Rhino.Geometry.Arc(new Circle(5), Math.PI / 4.0);
# ---------- end arc ----------
box = CSharpScript()  # -> out, A
# ---------- box: C# ----------
    A = new Rhino.Geometry.Box(Plane.WorldXY, new Interval(0, 1), new Interval(-1, 1), new Interval(0, 3));
# ---------- end box ----------
rect = CSharpScript()  # -> out, A
# ---------- rect: C# ----------
    A = new Rhino.Geometry.Rectangle3d(Plane.WorldXY, 2, 4);
# ---------- end rect ----------
pl = CSharpScript()  # -> out, A
# ---------- pl: C# ----------
    var p = new Rhino.Geometry.Polyline(0);
    p.Add(1, 3, 4);
    p.Add(4, 2, 8);
    p.Add(0, 2, 5);
    A = p;
# ---------- end pl ----------
intcrv = CSharpScript()  # -> out, A; inputs x: Curve
# ---------- intcrv: C# ----------
    A = Rhino.Geometry.NurbsCurve.CreateInterpolatedCurve(new Point3d[]{new Point3d(0, 0, 0),new Point3d(5, 3, 0),new Point3d(8, -1, 0)}, 3);
# ---------- end intcrv ----------
